# Dynamo custom node Arrowhead Assigner.dyf (Dynamo 0.9.0.3067)
# category: Rhythm.Tools
# This node assings the arrowhead type for all text and keynote tags. There is an input for ones you want to exclude.

categories = Categories("TextNotes")
convertTextNotes = Input(convertTextNotes : bool=false)
toggle = Custom[Rhythm.Toggle](list=categories, boolean=convertTextNotes)  # Toggle that offers two outputs. Created for Dynamo 0.8.1 because of changes to the "IF" node
categories_2 = Categories("KeynoteTags")
convertKeynoteTags = Input(convertKeynoteTags : bool=false)
toggle_2 = Custom[Rhythm.Toggle](list=categories_2, boolean=convertKeynoteTags)
categories_3 = Categories("RoomTags")
convertRoomTags = Input(convertRoomTags : bool=false)
toggle_3 = Custom[Rhythm.Toggle](list=categories_3, boolean=convertRoomTags)
categories_4 = Categories("DoorTags")
convertDoorTags = Input(convertDoorTags : bool=false)
toggle_4 = Custom[Rhythm.Toggle](list=categories_4, boolean=convertDoorTags)
categories_5 = Categories("WindowTags")
convertWindowTags = Input(convertWindowTags : bool=false)
toggle_5 = Custom[Rhythm.Toggle](list=categories_5, boolean=convertWindowTags)
categories_6 = Categories("WallTags")
convertWallTags = Input(convertWallTags : bool=false)
toggle_6 = Custom[Rhythm.Toggle](list=categories_6, boolean=convertWallTags)
create = List.Create(toggle.in, toggle_2.in, toggle_3.in, toggle_4.in, toggle_5.in, toggle_6.in)
RunMe = Input(RunMe : bool=false)
toggle_7 = Custom[Rhythm.Toggle](list=create, boolean=RunMe)
all_elements_of_category = ElementsOfCategory(toggle_7.in)
flatten = Flatten(all_elements_of_category)
type = Custom[Element.Type](element_s=flatten)  # This retrieves the element type of the given elements. (if available) Similar to others available but no python here.
string = StringInput("Leader Arrowhead")
arrowheadType = Input(arrowheadType : string)

# group: Gets the arrowhead type
element_types = ElementTypes("ElementType")
all_elements_of_type = ElementsOfType(element_types)
name = Element.Name(all_elements_of_type)
indexOf = IndexOf(name, arrowheadType)
getItemAtIndex = List.GetItemAtIndex(list=all_elements_of_type, index=indexOf)

setParameterByName = Element.SetParameterByName(element=type, parameterName=string, value=getItemAtIndex)
