# Dynamo custom node Rhythm.3DRoomTags.dyf (Dynamo 1.2.3.573)
# category: Rhythm.Tools
# This node will generate 3D room tags for all rooms in the model. (RFA in extra folder in Dynamo download)

ThreeDRoomTag = Input(ThreeDRoomTag : FamilyType)
categories = Categories("Rooms")
RunMe = Input(RunMe : bool=false)
toggle = Custom[Rhythm.Toggle](list=categories, boolean=RunMe)  # Toggle that offers two outputs. Created for Dynamo 0.8.1 because of changes to the "IF" node

# group: This filters out unplaced rooms
all_elements_of_category = ElementsOfCategory(toggle.in)
code_block = CodeBlock { "Area"; ""; }

flatten = Flatten(all_elements_of_category)

# group (continued): This filters out unplaced rooms
getParameterValueByName = Element.GetParameterValueByName(element=flatten, parameterName=code_block.out0)
ne = getParameterValueByName != code_block.out1
filterByBoolMask = List.FilterByBoolMask(list=flatten, mask=ne)

Phase = Input()
isPhaseCreatedValid = Custom[Element.IsPhaseCreatedValid](elements=filterByBoolMask.in, phase=Phase)  # This will determine if the input phase is the correct one for the input elements

# group: This area filters for user selected phase
filterByBoolMask_2 = List.FilterByBoolMask(list=filterByBoolMask.in, mask=isPhaseCreatedValid)

# group: Room locations and parameters.
location = Room.Location(filterByBoolMask_2.in)
number = Room.Number(filterByBoolMask_2.in)

code_block_2 = CodeBlock { "Name"; }
getParameterValueByName_2 = Element.GetParameterValueByName(element=filterByBoolMask_2.in, parameterName=code_block_2)

# group: Creates tag and sets parameters.
byPoint = FamilyInstance.ByPoint(familyType=ThreeDRoomTag, point=location)
code_block_3 = CodeBlock { "Name"; "Number"; }
setParameterByName = Element.SetParameterByName(element=byPoint, parameterName=code_block_3.out0, value=getParameterValueByName_2)
setParameterByName_2 = Element.SetParameterByName(element=byPoint, parameterName=code_block_3.out1, value=number)

clean = Custom[Output.Clean](input=setParameterByName)  # This will return a single value or list from one input.
ThreeDRoomTags = Output(clean)
